# Grasshopper definition windrose_plot.gh (Grasshopper 1.0.7)

panel = Panel("https://www.energyplus.net/weather-download/asia_wmo_region_2/CHN//CHN_Beijing.Beijing.545110_SWERA/all")
downloadepw = LBDownloadWeather(weather_URL=panel)  # -> epw_file, stat_file, ddy_file; plug-in component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
importepw = LBImportEPW(epw_file=downloadepw.epw_file)  # -> location, dry_bulb_temperature, dew_point_temperature, relative_humidity, wind_speed, wind_direction, direct_normal_rad, diffuse_horizontal_rad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; plug-in component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
windrose = LBWindRose(
    data=[importepw.wind_speed, importepw.dry_bulb_temperature],
    wind_direction=importepw.wind_direction,
    show_calmrose=Toggle(False),
    show_freq=Toggle(False),
    freq_hours="100",
    statement="0 <= a < 25 and 10 < b < 25")  # -> report, mesh, compass, orient_line, freq_line, windrose_line, legend, title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; plug-in component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
data = Data(windrose.freq_line)
data_2 = Data([windrose.windrose_line, windrose.compass, windrose.mesh])
panel_2 = Panel(data)
exportuo = LBExportUserObject(
    components=windrose.mesh,
    folder="C:\Users\Administrator\master\git\ladybug-grasshopper",
    change_type="fix",
    export=Toggle(False))  # -> report; plug-in component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
panel_3 = Panel(exportuo)
